vi "Add State(s) to Queue.gvi"   [LabVIEW Platform Developer Preview 0.1.0]
# Concatenates states in the JKI State Machine. Unwired inputs are safely ignored and will not be added to the state queue.
# For instructions on how to use the JKI State Machine, examples and video tutorials, visit:
# http://jkisoft.com/state-machine/
# Inputs:
#      State(s) in Front: This allows you to place new states in the front of the state machine queue. The default is an empty string.
#      State(s) in: Wire the existing states to this input. The default is an empty string.
#      State(s) in Back: This allows you to place new states in the back of the state machine queue.  The default is an empty string.
# Outputs:
#      States Out:This output returns a concatenation of all the inputs seperated by a line feed character. The line feed character is required by the JKI State Machine.
inputs:
  "State(s) in Front (\"\")": string  # This allows you to place new states in the front of the state machine queue. The default is an empty string.
  "State(s) in (\"\")": string  # Wire the existing states to this input. The default is an empty string.
  "State(s) at Back (\"\")": string  # This allows you to place new states in the back of the state machine queue. The default is an empty string.
outputs:
  "States Out": string  # This output returns a concatenation of all the inputs seperated by a line feed character. The line feed character is required by the JKI State Machine.
uses:
  NI::G Core::Strings::Trim Whitespace.gvi
diagram:
  # For instructions on how to use the JKI State Machine, examples and video tutorials, visit:
  # http://jki.net/state-machine/
  #
  # JKI State Machine™
  # http://jki.net/state-machine/
  # Copyright (C) 2005-2015, JKI
  call "Trim Whitespace.gvi"(string=$"State(s) at Back (\"\")") -> (trimmed string=w1)
  call "Trim Whitespace.gvi"(string=$"State(s) in Front (\"\")") -> (trimmed string=w2)
  Is Empty String Or Path(string/path=w2) -> w3
  Concatenate Strings(w2, "\n") -> w4
  Select(s=w3, t="", f=w4) -> w5
  call "Trim Whitespace.gvi"(string=$"State(s) in (\"\")") -> (trimmed string=w6)
  Is Empty String Or Path(string/path=w6) -> w7
  Concatenate Strings(w6, "\n") -> w8
  Select(s=w7, t="", f=w8) -> w9
  Concatenate Strings(w5, w9, w1) -> w10
  call "Trim Whitespace.gvi"(string=w10) -> (trimmed string=w11)
  $"States Out" <- w11
