vi "Parse State Queue.gvi"   [LabVIEW Platform Developer Preview 0.1.0]
# Parses the JKI State Machine state queue and returns the current state that will execute next with the associated arguments.
# For instructions on how to use the JKI State Machine, examples and video tutorials, visit:
# http://jkisoft.com/state-machine/
# Inputs:
#      State Queue: The entire state queue is wired to this input. This should come from the main JKI State Machine shift register.
#      Error In The error cluster from the JKI State Machine is wired to this input. If an error occures and appears on this input, the current state output returns the "Error Handler" state.
# Outputs:
#      Remaining States: Returns all the next states that should execute after the current state completes. These should be passed through the current state in the state machine. These can also be modified or augmented within the current state if necessary.
#      Current State: Returns the current state that should execute next in the state machine. If an error is wired to the Error input then the current state output becomes "Error Handler".
#      Arguments:  Returns any argument(s) that may be used in the current state string. These arguments come after the ">>" characters. Note: The arguments variable must not contain any unprintable characters like linefeed or carriage return.
# State Syntax:
# StateCategory: State >> Argument
# Line Terminator: Line feed
#      Example:
# UI: Help >> About
# Where "UI" is the state category
# Where "Help" is the state
# Where "About" is the argument
#      Other Examples:
# App Data: Initialize
# UI: Initialize
# Help >> About
# Commenting:
# To add a comment use "//" or "#" and all text to the right will be ignored
#      Commenting Example:
# UI: Initialize // This initializes the UI
# # This whole line is a comment
# // Another comment line
inputs:
  "State Queue": string, required  # The entire state queue is wired to this input. This should come from the main JKI State Machine shift register.
  "Error In (no error)": error
outputs:
  "Remaining States": string  # Returns all the next states that should execute after the current state completes. These should be passed through the current state in the state machine. These can also be modified or augmented within the current state if necessary.
  "Current State": string  # Returns the current state that should execute next in the state machine. If an error is wired to the Error input then the current state output becomes "Error Handler".
  "Arguments": string  # Returns any argument(s) that may be used in the current state string. These arguments come after the ">>" characters
uses:
  NI::G Core::Strings::Trim Whitespace.gvi
diagram:
  # previous state + args >>
  # For instructions on how to use the JKI State Machine, examples and video tutorials, visit:
  # http://jki.net/state-machine/
  #
  # JKI State Machine™
  # http://jki.net/state-machine/
  # Copyright (C) 2005-2015, JKI <info@jki.net>
  # ALL RIGHTS RESERVED
  s1 = uninitialised  # shift register
  while {  # While Loop is used to capture previous state information
    Is First Call() -> w1
    Select(s=w1, t="", f=s1) -> w2
    case ($"Error In (no error)") {
      frame No Error {
        # Previous State + Arguments
        s2 = $"State Queue"  # shift register
        while {  # While current line is a comment and there are more lines to process
          # first line
          # Search for End Of Line
          # remaining lines
          Match Pattern(regular expression="[\\n\\r]+", string=s2) -> (after substring=w8, before substring=w9)
          w10 = ["//", "#", "/\\*"]  # Begin Comment Patterns
          # Trim Trailing Comments
          for {
            w11 = each element of w10
            Match Pattern(regular expression=w11, string=w9) -> (before substring=w14)
            String Length(string=w14) -> (length=w15)
            append w14 to w12
            append w15 to w13
          }
          Array Max And Min(array=w13) -> (min index(es)=w16)
          Array Index(array=w12) -> (out0[w16]=w17)
          # Search for Optional State Cmd after ">>"
          # state + args
          call "Trim Whitespace.gvi"(string=w17) -> (trimmed string=w6)
          Match Pattern(regular expression="[ \n]*>>[ \n]*", string=w17) -> (after substring=w18, before substring=w19)
          call "Trim Whitespace.gvi"(string=w18) -> (trimmed string=w5)
          # state
          call "Trim Whitespace.gvi"(string=w19) -> (trimmed string=w4)
          # args
          Is Empty String Or Path(string/path=w4) -> w20
          # Iterate again WHEN
          # state empty AND
          # remaining states NOT empty
          call "Trim Whitespace.gvi"(string=w8) -> (trimmed string=w21)
          Is Empty String Or Path(string/path=w21) -> w22
          Logical And(w20, not w22) -> w23
          next s2 = w21
          continue if w23
        }
        w3 = s2
        w7 = w2
      }
      frame Error {
        # Previous Error State + Arguments
        w3 = $"State Queue"
        w4 = "Error Handler"
        w5 = default
        w6 = "Error Handler"
        w7 = w2
      }
    }
    next s1 = w6
    stop if TRUE
  }
  $"Current State" <- w4
  $Arguments <- w5
  $"Remaining States" <- w3
