vi "VI Tree - JKI State Machine.gvi"   [LabVIEW Platform Developer Preview 0.1.0]
uses:
  Library::String-Based Queued State Machine (Basic 1.0).gvi
  JKI::Library::JKI State Machine::Parse State Queue.gvi
  JKI::Library::JKI State Machine::Add State(s) to Queue.gvi
  JKI::Library::JKI State Machine::Build State String with Arguments.gvi
diagram:
  call "String-Based Queued State Machine (Basic 1.0).gvi"()
  call "Parse State Queue.gvi"(State Queue="", Error In (no error)=no error)
  call "Add State(s) to Queue.gvi"()
  call "Build State String with Arguments.gvi"(State="")
