vi "Build State String with Arguments.gvi"   [LabVIEW Platform Developer Preview 0.1.0]
# Builds a state string that contains arguments for the JKI State Machine.
# For Example: If State = A and Arguments = B then State with Arguments = A >> B
# For instructions on how to use the JKI State Machine, examples and video tutorials, visit:
# http://jkisoft.com/state-machine/
# Inputs:
#      State: The State string that requires the argument.
#      Arguments: The Argument string to add to the state. The default is an empty string. If Argument is an empty string then State will be returned to the output. Note: The arguments input must not contain any unprintable characters like linefeed or carriage return.
# Outputs:
#      State with Arguments: This output returns the new string that contains the State and the Argument. For Example: If State = A and Arguments = B then State with Arguments = A >> B
inputs:
  "State": string, required  # The State string that requires the argument.
  "Arguments (\"\")": string  # The Argument string to add to the state. The default is an empty string. If Argument is an empty string then State will be returned to the output.
outputs:
  "State with Arguments": string  # This output returns the new string that contains the State and the Argument. For Example: If State = A and Arguments = B then State with Arguments = A >> B
uses:
  NI::G Core::Strings::Trim Whitespace.gvi
diagram:
  call "Trim Whitespace.gvi"(string=$State) -> (trimmed string=w1)
  # For instructions on how to use the JKI State Machine, examples and video tutorials, visit:
  # http://jki.net/state-machine/
  #
  # JKI State Machine™
  # http://jki.net/state-machine/
  # Copyright (C) 2005-2015, JKI <info@jki.net>
  # ALL RIGHTS RESERVED
  call "Trim Whitespace.gvi"(string=$"Arguments (\"\")") -> (trimmed string=w2)
  Is Empty String Or Path(string/path=w2) -> w3
  case (w3) {  # Is arguments empty? If so, then do not append arguments
    frame False, Default {
      Concatenate Strings(w1, " >> ", w2) -> w4
    }
    frame True {
      w4 = w1
    }
  }
  $"State with Arguments" <- w4
