vi "JKI State Machine.gvi"   [LabVIEW NXG 3.0.0]
# This VI template must be instantiated by dropping it on the diagram of a new blank VI directly from the palettes. Do not use the template directly.
# The JKI State Machine™ is a template you can use for quickly creating your own LabVIEW applications. This is the very same template that is used by the JKI team, nearly every day, and is the result of years of refinement by our team of LabVIEW experts.
# For instructions on how to use the JKI State Machine, examples and video tutorials, visit:
# http://jki.net/state-machine/
panel controls:
  "Stop": bool
  "Help": bool
types:
  T1 = cluster{"Current VI Reference": VIRefnum, "Close Panel on Exit?": bool}
  T2 = cluster{"Core": T1, "Your Boolean data": bool, "Your string data": string}
uses:
  JKI::Library::JKI State Machine::Add State(s) to Queue.gvi
  JKI::Library::JKI State Machine::Parse State Queue.gvi
  NI::G Core::Error::Build Error Cluster.gvi
  NI::G Core::Error::Display Error.gvi
  NI::G Core::URL::Open URL in Default Browser (string).gvi
diagram:
  call "Add State(s) to Queue.gvi"(State(s) in ("")="Macro: Initialize") -> (States Out=w1)
  # ***IMPORTANT*** To get this JKI State Machine to run in NXG 3.0, you need to remove the Stop and Help buttons from the "Unplaced Items" on the Front Panel and then reassociate their Value Changed events in the Event Structure frames. This is due to a bug in NXG 3.0
  # = State Syntax =
  # StateCategory: State >> Argument
  # Line Terminator: Line feed
  # Example:
  # UI: Help >> About
  #
  # Where "UI" is the state category
  # Where "Help" is the state
  # Where "About" is the argument
  # Other Examples:
  # App Data: Initialize
  # UI: Initialize
  # Help >> About
  #
  # = Commenting =
  # To add a comment use "//" or "#" and all text to the right will be ignored
  # Commenting Example:
  # UI: Initialize // This initializes the UI
  # # This whole line is a comment
  # // Another comment line
  # For instructions on how to use the JKI State Machine, examples and video tutorials, visit:
  # http://jki.net/state-machine/
  #
  # JKI State Machine™
  # http://jki.net/state-machine/
  # Copyright (C) 2005-2018, JKI <info@jki.net>
  # ALL RIGHTS RESERVED
  s1 = uninitialised  # shift register
  s2 = uninitialised  # shift register
  s3 = w1  # shift register
  while {
    call "Parse State Queue.gvi"(State Queue=s3, Error In (no error)=s2) -> (Remaining States=w2, Current State=w3, Arguments=w4)
    w5 = -1  # Timeout
    # JKI State Machine NXG 3.0				Template Copyright © 2018 JKI	 - http://jki.net/state-machine
    # -1 =
    # wait
    # forever
    case (w3) ignore case {
      frame "", "Event Structure", "Idle" {
        # executes when the state queue is empty
        event (timeout = w5) {
          on Timeout {
            # Timeout Frame
            # (this will only execute if the Event Structure timeout is >= 0)
            call "Add State(s) to Queue.gvi"(State(s) in ("")=w2) -> (States Out=w7)
            w6 = s2
            w9 = s1
          }
          on "Stop" Value changed {
            call "Add State(s) to Queue.gvi"(State(s) in Front ("")="Macro: Exit", State(s) in ("")=w2) -> (States Out=w7)
            # Stop Button Value Change (pressed) Event
            # (this executes Macro: Exit to terminate the VI)
            w6 = s2
            w9 = s1
          }
          on "Help" Value changed {
            call "Add State(s) to Queue.gvi"(State(s) in Front ("")="UI: Help", State(s) in ("")=w2) -> (States Out=w7)
            # Exit Button Value Change (pressed) Event
            # (this executes Macro: Exit to terminate the VI)
            w6 = s2
            w9 = s1
          }
        }
        w8 = default
      }
      frame "---------- Core ----------" {
        # Do not put any code in this frame.
        # (it is a separator no-op)
        call "Add State(s) to Queue.gvi"(State(s) in ("")=w2) -> (States Out=w7)
        w6 = s2
        w8 = default
        w9 = s1
      }
      frame Default {
        # Do not delete, rename, or modify this frame.
        # (this is used to capture unhandled states and typos)
        call "Add State(s) to Queue.gvi"(State(s) in ("")=w2) -> (States Out=w7)
        Format Into String(formatString="Software Exception: Unhandled State \"%s\".", errIn=s2, w3) -> (outString=w10, errOut=w11)
        # Handle mistyped state name (developer tool)
        call "Build Error Cluster.gvi"(code="Generic error"(42), description=w10, error in=w11, include call chain=TRUE) -> (error out=w6)
        w8 = default
        w9 = s1
      }
      frame "Initialize Core Data" {
        call "Add State(s) to Queue.gvi"(State(s) in ("")=w2) -> (States Out=w7)
        # Do not delete, rename, or modify this frame.
        # (this is used to determine panel behavior on exit)
        Property Node(instance in=s1, "Core:Current VI Reference"=VIRefnum constant, "Core:Close Panel on Exit?"=FALSE) -> (instance out=w9)
        w6 = s2
        w8 = default
      }
      frame "Error Handler" {
        # Handle any errors here.
        # You can also output any states to clean-up after errors occur
        call "Add State(s) to Queue.gvi"(State(s) in Front ("")="/* Post Error States", State(s) in ("")=w2) -> (States Out=w7)
        # Clear error
        # Unhandled Error -- Display it
        call "Display Error.gvi"(error in=s2)
        w6 = no error
        w8 = default
        w9 = s1
      }
      frame "Exit" {
        # Do not put any code in this frame.
        # (No errors that occur here will be handled.)
        call "Add State(s) to Queue.gvi"(State(s) in ("")=w2) -> (States Out=w7)
        w12 = TRUE  # Stop
        w6 = s2
        w8 = w12
        w9 = s1
      }
      frame "---------- Data ----------" {
        # Do not put any code in this frame.
        # (It is a separator no-op. You can make a copy of this frame to create a new Data frame)
        call "Add State(s) to Queue.gvi"(State(s) in ("")=w2) -> (States Out=w7)
        w6 = s2
        w8 = default
        w9 = s1
      }
      frame "Data: Initialize" {
        # Initialize the shift-register data, here.
        # (data names are defined by what you wire into the bundle function)
        call "Add State(s) to Queue.gvi"(State(s) in ("")=w2) -> (States Out=w7)
        # Add new data here.
        w13 = ""  # Your string data
        w14 = TRUE  # Your Boolean data
        # do not delete - used by framework
        w15 = T1 {all zero or empty}  # Core
        # Data names and types of shift register data are defined by this bundle.
        # Expand Bundle to add new data elements to shift register data.
        Property Node(instance in=T2 {all zero or empty}, "Core"=w15, "Your Boolean data"=w14, "Your string data"=w13) -> (instance out=w9)
        w6 = s2
        w8 = default
      }
      frame "Data: Cleanup" {
        # Cleanup any data and references, here.
        # (this is called automatically, by the Macro: Exit)
        call "Add State(s) to Queue.gvi"(State(s) in ("")=w2) -> (States Out=w7)
        Property Node(instance in=s1)
        w6 = s2
        w8 = default
        w9 = s1
      }
      frame "---------- UI ----------" {
        # Do not put any code in this frame.
        # (It is a separator no-op. You can make a copy of this frame to create a new UI frame)
        call "Add State(s) to Queue.gvi"(State(s) in ("")=w2) -> (States Out=w7)
        w6 = s2
        w8 = default
        w9 = s1
      }
      frame "UI: Initialize" {
        # Initialize the User Interface, here.
        # (this is called automatically, by the Macro: Init)
        call "Add State(s) to Queue.gvi"(State(s) in ("")=w2) -> (States Out=w7)
        w6 = s2
        w8 = default
        w9 = s1
      }
      frame "UI: Help" {
        # Opens a help URL in the browser.
        call "Add State(s) to Queue.gvi"(State(s) in ("")=w2) -> (States Out=w7)
        call "Open URL in Default Browser (string).gvi"(URL="http://jki.net/state-machine", error in=s2) -> (error out=w6)
        w8 = default
        w9 = s1
      }
      frame "---------- Macro ----------" {
        # Do not put any code in this frame.
        # (It is a separator no-op. You can make a copy of this frame to create a new Macro frame)
        call "Add State(s) to Queue.gvi"(State(s) in ("")=w2) -> (States Out=w7)
        w6 = s2
        w8 = default
        w9 = s1
      }
      frame "Macro: Initialize" {
        # Initialization Macro
        # (This is called once, when the VI starts)
        w16 = "Data: Initialize\nInitialize Core Data\nUI: Initialize\n// UI: Front Panel State >> Open"
        call "Add State(s) to Queue.gvi"(State(s) in Front ("")=w16, State(s) in ("")=w2) -> (States Out=w7)
        w6 = s2
        w8 = default
        w9 = s1
      }
      frame "Macro: Exit" {
        # Exit Macro
        # (This is called once, when the VI exits)
        call "Add State(s) to Queue.gvi"(State(s) in Front ("")="Data: Cleanup\nExit", State(s) in ("")=w2) -> (States Out=w7)
        w6 = s2
        w8 = default
        w9 = s1
      }
      frame "---------- New Category ----------" {
        # Template Separator
        # (You can make a copy of, or modify, this frame)
        call "Add State(s) to Queue.gvi"(State(s) in ("")=w2) -> (States Out=w7)
        w6 = s2
        w8 = default
        w9 = s1
      }
      frame "New Category: 1" {
        # Your code here.
        # (You can make a copy of, or modify, this frame)
        call "Add State(s) to Queue.gvi"(State(s) in ("")=w2) -> (States Out=w7)
        w6 = s2
        w8 = default
        w9 = s1
      }
      frame "New Category: 2" {
        # Your code here.
        # (You can make a copy of, or modify, this frame)
        call "Add State(s) to Queue.gvi"(State(s) in ("")=w2) -> (States Out=w7)
        w6 = s2
        w8 = default
        w9 = s1
      }
    }
    next s1 = w9
    next s2 = w6
    next s3 = w7
    stop if w8
  }
